# Grasshopper definition am_wasp_direct_control.gh (Grasshopper 1.0.7)

mixer_ip = ValueList({"192.168.125.22", "192.168.125.23", "192.168.125.24"}, selected="192.168.125.24")
ext_ip = ValueList({"192.168.10.10", "192.168.10.20", "192.168.10.11", "192.168.10.12", "127.0.0.1", "192.168.10.111", "192.168.0.220", "192.168.0.30", "192.168.10.50", "0.0.0.0", "192.168.125.22"}, selected="192.168.125.22")
cfs_ip = ValueList({"192.168.125.22", "192.168.125.23", "192.168.125.24"}, selected="192.168.125.23")
mixer_port = ValueList({"50003", "50004"}, selected="50004")
ext_port = ValueList({"50003", "50004"}, selected="50004")
ext_port_2 = ValueList({"50003", "50004"}, selected="50004")

# ----
# Settings
# --> Set your IP address
# --> Set WASP IP address
server_ip = ValueList({"192.168.10.44", "192.168.10.12", "192.168.10.11", "192.168.10.10", "192.168.10.2", "127.0.0.1", "192.168.10.111", "192.168.0.250", "192.168.0.30", "10.42.0.212", "10.42.0.133"}, selected="192.168.0.250")
server_port = ValueList({"50002", "50003", "50005", "50006", "50007", "50008", "50009", "50010", "50011", "50012", "50013", "50014", "50015", "50016"}, selected="50005")
globals = PythonScript(
    server_ip=server_ip,
    server_port=server_port,
    ext_ip=ext_ip,
    ext_port=ext_port,
    cfs_ip=cfs_ip,
    cfs_port=ext_port_2,
    mixer_ip=mixer_ip,
    mixer_port=mixer_port,
    clear=Button())  # inputs server_port: Int32
# ---------- globals: Python ----------
from scriptcontext import sticky as st

st["server_ip"] = server_ip
st["server_port"] = server_port

st["ext_ip"] = ext_ip
st["ext_port"] = ext_port

st["cfs_ip"] = cfs_ip
st["cfs_port"] = cfs_port

st["mixer_ip"] = mixer_ip
st["mixer_port"] = mixer_port

if clear:
    st.clear()
# ---------- end globals ----------

speed = Slider(23000, range=0..51200)
max_speed = Slider(24000, range=0..51200)
value = BooleanToggle(True)
send = Button()
extruder_only = PythonScript(motor_state=value, max_speed=max_speed, speed=speed, send=send)  # -> urscript; inputs motor_state: Boolean
# ---------- extruder_only: Python ----------
import time
from scriptcontext import sticky as st
from extruder_control.extruderclient import ExtruderClient

ext_ip = st["ext_ip"]
ext_port = st["ext_port"]


ec = ExtruderClient(ext_ip, ext_port)

wait_for_response = False

if send:
    ec.connect()
    time.sleep(0.2)
    ec.send_motordata(motor_state, max_speed, speed, wait_for_response)
    time.sleep(0.2)
    ec.close()
# ---------- end extruder_only ----------

# ----
# Set Extruder data (only for tests without material)
speed_2 = Slider(23000, range=0..51200)
# Direct WASP control
# Set Extruder and CFS data
max_speed_2 = Slider(24000, range=0..51200)
value_2 = BooleanToggle(True)
send_2 = Button()
extruder_and_cfs = PythonScript(motor_state=value_2, max_speed=max_speed_2, speed=speed_2, send=send_2)  # -> urscript; inputs motor_state: Boolean
# ---------- extruder_and_cfs: Python ----------
import time
from scriptcontext import sticky as st
from extruder_control.extruderclient import ExtruderClient

ext_ip = st["ext_ip"]
ext_port = st["ext_port"]
cfs_ip = st["cfs_ip"]
cfs_port = st["cfs_port"]

ec = ExtruderClient(ext_ip, ext_port)
cfs = ExtruderClient(cfs_ip, cfs_port)

wait_for_response = False

if send:
    cfs.connect()
    ec.connect()
    time.sleep(0.2)
    cfs.send_motordata(motor_state, max_speed, speed/2, wait_for_response)
    ec.send_motordata(motor_state, max_speed, speed, wait_for_response)
    time.sleep(0.2)
    ec.close()
    cfs.close()
# ---------- end extruder_and_cfs ----------

# ----
# Turn Extrusion on/off
value_3 = BooleanToggle(False)
send_3 = Button()
extruder_state = PythonScript(state=value_3, send=send_3)  # -> urscript; inputs state: Boolean
# ---------- extruder_state: Python ----------
import time
from scriptcontext import sticky as st
from extruder_control.extruderclient import ExtruderClient

ext_ip = st["ext_ip"]
ext_port = st["ext_port"]
cfs_ip = st["cfs_ip"]
cfs_port = st["cfs_port"]

ec = ExtruderClient(ext_ip, ext_port)
cfs = ExtruderClient(cfs_ip, cfs_port)

wait_for_response = False

if send:
    cfs.connect()
    ec.connect()
    time.sleep(0.2)
    ec.send_motorstate(int(state), wait_for_response)
    cfs.send_motorstate(int(state), wait_for_response)
    time.sleep(0.2)
    ec.close()
    cfs.close()
# ---------- end extruder_state ----------

stop = Button()
stop_2 = PythonScript(stop=stop)
# ---------- stop_2: Python ----------
import time
from scriptcontext import sticky as st
from extruder_control.extruderclient import ExtruderClient

ext_ip = st["ext_ip"]
ext_port = st["ext_port"]
cfs_ip = st["cfs_ip"]
cfs_port = st["cfs_port"]

ec = ExtruderClient(ext_ip, ext_port)
cfs = ExtruderClient(cfs_ip, cfs_port)
wait_for_response = False

if stop:
    cfs.connect()
    ec.connect()
    time.sleep(0.2)
    ec.send_stop(wait_for_response)
    cfs.send_stop(wait_for_response)
    time.sleep(0.2)
    ec.close()
    cfs.close()
# ---------- end stop_2 ----------

# ----
# Set Mixer Data
max_speed_3 = Slider(10000, range=0..51200)
# Turn Mixer on/off
speed_3 = Slider(5000, range=0..51200)
value_4 = BooleanToggle(True)
send_4 = Button()
mixer_only = PythonScript(motor_state=value_4, max_speed=max_speed_3, speed=speed_3, send=send_4)  # -> urscript; inputs motor_state: Boolean
# ---------- mixer_only: Python ----------
import time
from scriptcontext import sticky as st
from extruder_control.extruderclient import ExtruderClient

mixer_ip = st["mixer_ip"]
mixer_port = st["mixer_port"]

mixer = ExtruderClient(mixer_ip, mixer_port)

wait_for_response = False

if send:
    mixer.connect()
    time.sleep(0.2)
    mixer.send_motordata(motor_state, max_speed, speed, wait_for_response)
    time.sleep(0.2)
    mixer.close()
# ---------- end mixer_only ----------

value_5 = BooleanToggle(False)
send_5 = Button()
extruder_state_2 = PythonScript(state=value_5, send=send_5)  # -> urscript; inputs state: Boolean
# ---------- extruder_state_2: Python ----------
import time
from scriptcontext import sticky as st
from extruder_control.extruderclient import ExtruderClient

mixer_ip = st["mixer_ip"]
mixer_port = st["mixer_port"]

mixer = ExtruderClient(mixer_ip, mixer_port)
wait_for_response = False

if send:
    mixer.connect()
    time.sleep(0.2)
    mixer.send_motorstate(int(state), wait_for_response)
    time.sleep(0.2)
    mixer.close()
# ---------- end extruder_state_2 ----------
